# Grasshopper definition FSM_Lego final.gh (Grasshopper 1.0.8)
# plug-ins: RhinoCodePluginGH, Portal, Human, MetaHopper

udp = UdpReceiver(Port="5005", Start=Toggle(True))
py3 = Python3Script(data=udp)  # -> a
# ---------- py3: Python ----------
data_bytes = bytearray(data)
a = data_bytes.decode("utf-8")
# ---------- end py3 ----------
panel = Panel("""start
scan
choose
assembly
finish""")
dsrmeta = DeserializeMetadata(Json=py3)  # -> State, Step, Selected_set, Pos_x, Pos_y
mindex = MemberIndex(Set=panel, Member=dsrmeta.State)  # -> Index, Count
mindex_2 = MemberIndex(Set=panel, Member=dsrmeta.State)  # -> Index, Count

equals = Equality(FirstNumber=mindex_2.Index, SecondNumber="3")  # -> Equality, Inequality
equals_2 = Equality(FirstNumber=dsrmeta.Step, SecondNumber="2")  # -> Equality, Inequality
equals_3 = Equality(FirstNumber=dsrmeta.Step, SecondNumber="3")  # -> Equality, Inequality
equals_4 = Equality(FirstNumber=dsrmeta.Step, SecondNumber="4")  # -> Equality, Inequality
equals_5 = Equality(FirstNumber=dsrmeta.Step, SecondNumber="5")  # -> Equality, Inequality
equals_6 = Equality(FirstNumber=dsrmeta.Step, SecondNumber="6")  # -> Equality, Inequality
equals_7 = Equality(FirstNumber=dsrmeta.Step, SecondNumber="1")  # -> Equality, Inequality
and = GateAnd(A=equals.Equality, B=equals_2.Equality)
and_2 = GateAnd(A=equals.Equality, B=equals_3.Equality)
and_3 = GateAnd(A=equals.Equality, B=equals_4.Equality)
and_4 = GateAnd(A=equals.Equality, B=equals_5.Equality)
and_5 = GateAnd(A=equals.Equality, B=equals_6.Equality)
and_6 = GateAnd(A=equals.Equality, B=equals_7.Equality)
onoff = EnableDisableObject(Enabled=and_6, AllObjects_Object=previewmat_11)
onoff_2 = EnableDisableObject(Enabled=and, AllObjects_Object=previewmat_13)
onoff_3 = EnableDisableObject(Enabled=and_2, AllObjects_Object=previewmat_14)
onoff_4 = EnableDisableObject(Enabled=and_3, AllObjects_Object=previewmat_15)
onoff_5 = EnableDisableObject(Enabled=and_4, AllObjects_Object=previewmat_16)
onoff_6 = EnableDisableObject(Enabled=and_5, AllObjects_Object=previewmat_12)

equals_8 = Equality(FirstNumber=mindex.Index, SecondNumber="2")  # -> Equality, Inequality
equals_9 = Equality(FirstNumber=mindex.Index, SecondNumber="2")  # -> Equality, Inequality
onoff_7 = EnableDisableObject(Enabled=equals_8.Equality, AllObjects_Object=[previewmat_4, previewmat_3, previewmat_5, previewmat_6])
onoff_8 = EnableDisableObject(Enabled=equals_9.Equality)  # disabled

equals_10 = Equality(FirstNumber=mindex.Index, SecondNumber="3")  # -> Equality, Inequality
onoff_9 = EnableDisableObject(Enabled=equals_10.Equality, AllObjects_Object=[previewmat_7, previewmat_8, previewmat_9, previewmat_10])

# ----
# Actions
# Start
panel_2 = Panel("0")
equals_11 = Equality(FirstNumber=mindex.Index, SecondNumber=panel_2)  # -> Equality, Inequality
srf = Surface(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)
# Choose between 4 models
path = FilePath("C:\Users\clarr\Desktop\YOLOO\data\interface_images\lego_13.jpg")
previewmat = CustomPreviewMaterials(Geometry=srf, DiffuseColor=RGB(255, 255, 255), DiffuseBitmap=path)  # disabled
onoff_10 = EnableDisableObject(Enabled=equals_11.Equality)

# ----
# Finish
panel_3 = Panel("4")
equals_12 = Equality(FirstNumber=mindex_2.Index, SecondNumber=panel_3)  # -> Equality, Inequality
srf_2 = Surface(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)
path_2 = FilePath("C:\Users\clarr\Desktop\YOLOO\data\interface_images\lego_14.jpg")
previewmat_2 = CustomPreviewMaterials(Geometry=srf_2, DiffuseColor=RGB(255, 255, 255), DiffuseBitmap=path_2)
onoff_11 = EnableDisableObject(Enabled=equals_12.Equality)

# ----
# Enable_model 2
path_3 = FilePath("C:\Users\clarr\Desktop\YOLOO\data\interface_images\lego_7.jpg")
srf_3 = Surface(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)
previewmat_3 = CustomPreviewMaterials(Geometry=srf_3, DiffuseColor=RGB(255, 255, 255), DiffuseBitmap=path_3)

# ----
# Enable_model 1
path_4 = FilePath("C:\Users\clarr\Desktop\YOLOO\data\interface_images\lego_6.jpg")
srf_4 = Surface(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)
previewmat_4 = CustomPreviewMaterials(Geometry=srf_4, DiffuseColor=RGB(255, 255, 255), DiffuseBitmap=path_4)

# ----
# Enable_model 3
srf_5 = Surface(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)
path_5 = FilePath("C:\Users\clarr\Desktop\YOLOO\data\interface_images\lego_8.jpg")
previewmat_5 = CustomPreviewMaterials(Geometry=srf_5, DiffuseColor=RGB(255, 255, 255), DiffuseBitmap=path_5)

# ----
# Enable_model 4
srf_6 = Surface(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)
# Model selected enable
path_6 = FilePath("C:\Users\clarr\Desktop\YOLOO\data\interface_images\lego_9.jpg")
previewmat_6 = CustomPreviewMaterials(Geometry=srf_6, DiffuseColor=RGB(255, 255, 255), DiffuseBitmap=path_6)

# ----
# Disable_model 1
srf_7 = Surface(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)
path_7 = FilePath("C:\Users\clarr\Desktop\YOLOO\data\interface_images\lego_10.jpg")
previewmat_7 = CustomPreviewMaterials(Geometry=srf_7, DiffuseColor=RGB(255, 255, 255), DiffuseBitmap=path_7)  # disabled

# ----
# Disable_model 2
srf_8 = Surface(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)
path_8 = FilePath("C:\Users\clarr\Desktop\YOLOO\data\interface_images\lego_11.jpg")
previewmat_8 = CustomPreviewMaterials(Geometry=srf_8, DiffuseColor=RGB(255, 255, 255), DiffuseBitmap=path_8)  # disabled

# ----
# Disable_model 3
srf_9 = Surface(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)
path_9 = FilePath("C:\Users\clarr\Desktop\YOLOO\data\interface_images\lego_12.jpg")
previewmat_9 = CustomPreviewMaterials(Geometry=srf_9, DiffuseColor=RGB(255, 255, 255), DiffuseBitmap=path_9)  # disabled

# ----
# Enable_model 4
srf_10 = Surface(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)
# Assembly
path_10 = FilePath("C:\Users\clarr\Desktop\YOLOO\data\interface_images\lego_9.jpg")
previewmat_10 = CustomPreviewMaterials(Geometry=srf_10, DiffuseColor=RGB(255, 255, 255), DiffuseBitmap=path_10)  # disabled

# ----
# Model 4 assembly_step 1
path_11 = FilePath("C:\Users\clarr\Desktop\YOLOO\data\interface_images\1.paso6.jpg")
srf_11 = Surface(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)
previewmat_11 = CustomPreviewMaterials(Geometry=srf_11, DiffuseColor=RGB(255, 255, 255), DiffuseBitmap=path_11)  # disabled

# ----
# Model 4 assembly_step 5
srf_12 = Surface(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)
path_12 = FilePath("C:\Users\clarr\Desktop\YOLOO\data\interface_images\1.paso2.jpg")
previewmat_12 = CustomPreviewMaterials(Geometry=srf_12, DiffuseColor=RGB(255, 255, 255), DiffuseBitmap=path_12)  # disabled

# ----
# Model 4 assembly_step 2
srf_13 = Surface(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)
path_13 = FilePath("C:\Users\clarr\Desktop\YOLOO\data\interface_images\1.paso5.jpg")
previewmat_13 = CustomPreviewMaterials(Geometry=srf_13, DiffuseColor=RGB(255, 255, 255), DiffuseBitmap=path_13)  # disabled

# ----
# Model 4 assembly_step 3
srf_14 = Surface(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)
path_14 = FilePath("C:\Users\clarr\Desktop\YOLOO\data\interface_images\1.paso4.jpg")
previewmat_14 = CustomPreviewMaterials(Geometry=srf_14, DiffuseColor=RGB(255, 255, 255), DiffuseBitmap=path_14)  # disabled

# ----
# Model 4 assembly_step 4
srf_15 = Surface(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)
path_15 = FilePath("C:\Users\clarr\Desktop\YOLOO\data\interface_images\1.paso3.jpg")
previewmat_15 = CustomPreviewMaterials(Geometry=srf_15, DiffuseColor=RGB(255, 255, 255), DiffuseBitmap=path_15)  # disabled

# ----
# Model 4 assembly_step 6
srf_16 = Surface(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)
path_16 = FilePath("C:\Users\clarr\Desktop\YOLOO\data\interface_images\1.paso1.jpg")
previewmat_16 = CustomPreviewMaterials(Geometry=srf_16, DiffuseColor=RGB(255, 255, 255), DiffuseBitmap=path_16)  # disabled

# ----
# Pieces CP
subtraction = Subtraction(A=1, B=dsrmeta.Pos_y)
concat = Concatenate(FragmentA=dsrmeta.Pos_x, FragmentB=",", FragmentC=subtraction)
onoff_12 = EnableDisableObject(Enabled=equals.Equality, AllObjects_Object=cloud)
evalsrf = EvaluateSurface(Surface=reparameterize(srf), Point=concat)  # -> Point, Normal, UDirection, VDirection, Frame
number_slider = Slider(2, range=0..50)
cir = Circle(Plane=evalsrf.Point, Radius=number_slider)
cloud = CloudDisplay(Points=evalsrf.Point, Colours=ColourSwatch(SwatchColor=RGB(255, 255, 0)), Size=number_slider, SpriteType=1)  # disabled
